# Grasshopper definition parametryczna studnia.gh (Grasshopper 1.0.7)
# plug-ins: jSwan

serialize_json = SerializeJson(
    ChamberLengthOrRadius=Slider(500, range=0..10000),
    WallThickness=Slider(60, range=0..110),
    IncludeNullAndEmptyProperties=True)
panel = Panel("""ChamberLengthOrRadius
ChamberWidth
InvertLevel
SoffitLevel
WallMaterial
WallThickness
BaseMaterial
BaseThickness
WithBackdrop
AccessCoverMaterial
AccessLengthOrRadius
AccessWidth
AccessCoverLoadRating
ReductionHeight
ReductionType
SealType
LadderType
NoBottom
StrengthClass""")
panel_2 = Panel(serialize_json)
deserialize_json = DeserializeJson(JSON=serialize_json, OutputsLocked=False)  # -> ChamberLengthOrRadius, ChamberWidth, InvertLevel, SoffitLevel, WallMaterial, WallThickness, BaseMaterial, BaseThickness
multiplication = Multiplication(B="2")
addition = Addition(A=deserialize_json.ChamberLengthOrRadius, B=multiplication)
linia_osi = Curve(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)
pipe = Pipe(Curve=linia_osi, Radius=deserialize_json.ChamberLengthOrRadius, Caps=0)
pipe_2 = Pipe(Curve=linia_osi, Radius=addition, Caps=0)
