# Grasshopper definition parametryczna studnia.gh (Grasshopper 1.0.7)
# plug-ins: jSwan

panel = Panel("STUD-1")
distributionchamber = SerializeJson(
    ID="STUD-1",
    ChamberLengthOrRadius=Slider(1200, range=0..10000),
    InvertLevel=Slider(-3.5, range=-10..0),
    SoffitLevel=Slider(-1, range=-10..0),
    WallThickness=Slider(160, range=0..1000),
    BaseThickness=Slider(150, range=0..1000),
    CoverThickness=Slider(200, range=0..1000),
    IncludeNullAndEmptyProperties=True)
port = SerializeJson(
    IDStudni=panel,
    PortNumber=Slider(1, range=0..1),
    FlowDirection="source",
    Diameter=Slider(300, range=0..1000),
    KlasaSN="2",
    Angle=[Slider(0, range=0..359), Slider(90, range=0..359)],
    DistanceToInvertLevel=Slider(100, range=0..1000),
    ActualPortDiameter=Slider(330, range=0..1000),
    IncludeNullAndEmptyProperties=False)
deserialize_json = DeserializeJson(JSON=distributionchamber, OutputsLocked=False)  # -> ID, ChamberLengthOrRadius, ChamberWidth, InvertLevel, SoffitLevel, WallMaterial, WallThickness, BaseMaterial, BaseThickness, CoverThickness
deserialize_json_2 = DeserializeJson(JSON=port, OutputsLocked=False)  # -> IDStudni, PortNumber, FlowDirection, Diameter, KlasaSN, Angle, DistanceToInvertLevel, ActualPortDiameter
panel_2 = Panel(distributionchamber)
panel_3 = Panel(port)
multiplication = Multiplication(A=deserialize_json.InvertLevel, B=1000)
multiplication_2 = Multiplication(A=deserialize_json.SoffitLevel, B=1000)
multiplication_3 = Multiplication(A=deserialize_json.WallThickness, B="2")
addition = Addition(A=deserialize_json.ChamberLengthOrRadius, B=multiplication_3)
subtraction = Subtraction(A=multiplication, B=multiplication_2)
addition_2 = Addition(A=subtraction, B=deserialize_json_2.ActualPortDiameter)
addition_3 = Addition(A=addition_2, B=deserialize_json_2.DistanceToInvertLevel)
Z = UnitZ(Factor=addition_3)
addition_4 = Addition(A=deserialize_json_2.Angle, B="180")
xz = XZPlane(Origin=Z)
rad = Radians(Degrees=addition_4)
cyl = Cylinder(Base=PlaneXY(0, 0, 0), Radius=deserialize_json.ChamberLengthOrRadius, Length=subtraction)
cyl_2 = Cylinder(Base=PlaneXY(0, 0, 0), Radius=addition, Length=subtraction)

# ---- group: Base
cyl_3 = Cylinder(Base=PlaneXY(0, 0, 0), Radius=addition, Length=deserialize_json.BaseThickness)
subtraction_2 = Subtraction(A=subtraction, B=deserialize_json.BaseThickness)
Z_2 = UnitZ(Factor=subtraction_2)
cap = CapHoles(Brep=cyl_3)
move = Move(Geometry=cap, Motion=Z_2)  # -> Geometry, Transform

# ----
cyl_4 = Cylinder(Base=xz, Radius=deserialize_json_2.ActualPortDiameter, Length=addition)

# ---- group: Cover
cyl_5 = Cylinder(Base=PlaneXY(0, 0, 0), Radius=addition, Length=deserialize_json.CoverThickness)
Z_3 = UnitZ(Factor=1)
cap_2 = CapHoles(Brep=cyl_5)
move_2 = Move(Geometry=cap_2, Motion=Z_3)  # -> Geometry, Transform

# ----
neg = Negative(Value=rad)
cap_3 = CapHoles(Brep=cyl_4)
cap_4 = CapHoles(Brep=cyl_2)
cap_5 = CapHoles(Brep=cyl)
rotate = Rotate(Geometry=cap_3, Angle=neg, Plane=PlaneXY(0, 0, 0))  # -> Geometry, Transform
sdiff = SolidDifference(BrepsA=cap_4, BrepsB=cap_5)
sdiff_2 = SolidDifference(BrepsA=sdiff, BrepsB=rotate.Geometry)
